# Grasshopper definition Cantilever.gh (Grasshopper 1.0.8)
# Copyright: hrntsm
# plug-ins: Lemur Info, IguanaMesh

number_slider = Slider(10, range=0..10)
number_slider_2 = Slider(100, range=0..100)
number_slider_3 = Slider(10, range=0..10)
division = Division(A=number_slider_3, B="2")
number_slider_4 = Slider(100, range=0..100)
addition = Addition(A=number_slider, B=number_slider_3)
pt = ConstructPoint(XCoordinate=expr("x-10", number_slider_4), YCoordinate=division, ZCoordinate=expr("x+1", addition))
neg = Negative(Value=number_slider_2)
pt_2 = ConstructPoint(XCoordinate=number_slider_4, YCoordinate=number_slider_3, ZCoordinate=number_slider_3)
xy = XYPlane(Origin=pt)
dom = ConstructDomain(DomainStart=neg, DomainEnd=number_slider_2)
pt_3 = Point(Point(0, 0, 0))
box = Box2Pt(PointA=pt_3, PointB=pt_2, Plane=PlaneXY(0, 0, 0))
planesrf = PlaneSurface(Plane=xy, XSize=dom, YSize=dom)
sph = Sphere(Base=xy, Radius=number_slider)
number_slider_5 = Slider(5, range=0..10)
split = SplitBrep(Brep=sph, Cutter=planesrf)
item = ListItem(List=split, Index=0, Wrap=True)  # -> Item, Item1
ilineartetraprism = ILinearTetraPrism(
    MinimumSize=number_slider_5,
    MaximunSize=number_slider_5,
    CurvatureAdapt=False,
    MinimumElements=6,
    Optimization=0,
    QualityType=2,
    QualityThreshold=0.3,
    Massive_Refinement=False)
srf = Surface(item.Item1)
debrep = DeconstructBrep(Brep=box)  # -> Faces, Edges, Vertices
ifillbrep = IFillBrep(Brep=[box, sph], ISettings=ilineartetraprism)  # -> IMesh, Entities, Info
panel = Panel("""Cantilever
Ball""")
item_2 = ListItem(List=debrep.Faces, Index=Slider(3, range=0..5), Wrap=True)
item_3 = ListItem(List=debrep.Faces, Index=Slider(5, range=0..5), Wrap=True)
Z = UnitZ(Factor=Slider(5, range=0..10))
lefi = LeMeshFromIMesh(Header=panel, IMesh=ifillbrep.IMesh)  # -> LeMesh, Mesh
vec = VectorXYZ(XComponent=0, YComponent=0, ZComponent=0)  # -> Vector, Length
neg_2 = Negative(Value=Z)
conbc = ConstructBoundaryCondition(TargetGroupName="DISP", Type=Slider(0, range=0..10), Values=neg_2, Constraints=[True, True, True])
conbc_2 = ConstructBoundaryCondition(TargetGroupName="Fix", Type=0, Values=vec.Vector, Constraints=[True, True, True])
conss = ConstructSolverSettings(Method=Slider(0, range=0..12), Precondition=Slider(5, range=0..12), MaxIter=100, Residual=1e-08)
item_4 = ListItem(List=lefi.LeMesh, Index=0, Wrap=True)  # -> Item, Item1
concon = ConstructContact(Name="CP1", Slave="Fix", Master="Master", Algorithm=0, Interaction=1)  # -> ContactPair, ContactControl
conlemat = ConstructLeMaterial(Name="steel", Density="1", YoungsModulus="205000", PoissonRatio="0.3", TargetEGroup="EGRP1")
constep = ConstructStep(SubSteps=Slider(10, range=0..10), Convergence=1e-06, MaxIterations=100)
mergelemesh = MergeLeMesh(Header="BarWithBall", LeMesh1=item_4.Item, LeMesh2=item_4.Item1)  # -> LeMesh, Mesh
grpentire = GroupEntireLeMesh(Name="EGRP1", LeMesh=mergelemesh.LeMesh)
congrpsurf = GroupFromSurface(Name="Fix", LeMesh=mergelemesh.LeMesh, Surface=item_2, GroupType=Slider(0, range=0..2), Tolerance=1e-06)  # -> Group, Geometry
congrpsurf_2 = GroupFromSurface(Name="DISP", LeMesh=mergelemesh.LeMesh, Surface=srf, GroupType=Slider(0, range=0..2), Tolerance=1e-06)  # -> Group, Geometry
congrpsurf_3 = GroupFromSurface(Name="Master", LeMesh=mergelemesh.LeMesh, Surface=item_3, GroupType=Slider(2, range=0..2), Tolerance=1e-06)  # -> Group, Geometry
conlecnt = ConstructLeControl(
    SolutionType=Slider(1, range=0..1),
    BoundaryConditions=flatten([conbc_2, conbc]),
    ContactControl=concon.ContactControl,
    Step=constep,
    Solver=conss)
panel_2 = Panel(mergelemesh.LeMesh)
panel_3 = Panel(conlecnt)
conleasm = LeAssembleModel(
    LeMesh=mergelemesh.LeMesh,
    LeGrp=flatten([congrpsurf.Group, grpentire, congrpsurf_3.Group, congrpsurf_2.Group]),
    LeCntMsh=concon.ContactPair,
    LeMat=conlemat,
    LeCnt=conlecnt)
path = FilePath("C:\Users\hiroa\Desktop\lemur_test\")
panel_4 = Panel(conleasm)
leexe = LeExecute(LeAssemble=conleasm, Thread="-1", Process="4", Dir=path, Run=Toggle(True))
