# Grasshopper definition Cantilever_load.gh (Grasshopper 1.0.8)
# Copyright: hrntsm
# plug-ins: Pufferfish, Lemur Info, IguanaMesh

number_slider = Slider(10, range=0..10)
pt = ConstructPoint(XCoordinate=Slider(100, range=0..100), YCoordinate=number_slider, ZCoordinate=number_slider)
pt_2 = Point(Point(0, 0, 0))
box = Box2Pt(PointA=pt_2, PointB=pt, Plane=PlaneXY(0, 0, 0))

# ----
# Mesh Size
number_slider_2 = Slider(5, range=0..5)

ilineartetraprism = ILinearTetraPrism(
    MinimumSize=number_slider_2,
    MaximunSize=number_slider_2,
    CurvatureAdapt=True,
    MinimumElements=6,
    Optimization=1,
    QualityType=2,
    QualityThreshold=0.3,
    Massive_Refinement=True)
debrep = DeconstructBrep(Brep=box)  # -> Faces, Edges, Vertices
ifillbrep = IFillBrep(Brep=box, ISettings=ilineartetraprism)  # -> IMesh, Entities, Info
item = ListItem(List=debrep.Faces, Index=Slider(1, range=0..5), Wrap=True)
item_2 = ListItem(List=debrep.Faces, Index=Slider(3, range=0..5), Wrap=True)
vec = VectorXYZ(XComponent=0, YComponent=0, ZComponent=0)  # -> Vector, Length
lefi = LeMeshFromIMesh(Header="Cantilever", IMesh=ifillbrep.IMesh)  # -> LeMesh, Mesh
conss = ConstructSolverSettings(Method=Slider(12, range=0..12), Precondition=Slider(1, range=0..12), MaxIter=100, Residual=1e-08)
constep = ConstructStep(SubSteps=Slider(1, range=0..10), Convergence=1e-06, MaxIterations=100)
conlemat = ConstructLeMaterial(Name="steel", Density="1", YoungsModulus="205000", PoissonRatio="0.3", TargetEGroup="EGRP1")
grpentire = GroupEntireLeMesh(Name="EGRP1", LeMesh=lefi.LeMesh)
conbc = ConstructBoundaryCondition(TargetGroupName="Fix", Type=0, Values=vec.Vector, Constraints=[True, True, True])
congrpsurf = GroupFromSurface(Name="Fix", LeMesh=lefi.LeMesh, Surface=item_2, GroupType=Slider(0, range=0..2), Tolerance=1e-06)  # -> Group, Geometry, NodeIds
congrpsurf_2 = GroupFromSurface(Name="Load", LeMesh=lefi.LeMesh, Surface=item, GroupType=Slider(0, range=0..2), Tolerance=1e-06)  # -> Group, Geometry, NodeIds
lng = ListLength(List=congrpsurf_2.NodeIds)
division = Division(A=Slider(100, range=0..100), B=lng)
Z = UnitZ(Factor=division)
neg = Negative(Value=Z)
conbc_2 = ConstructBoundaryCondition(TargetGroupName="Load", Type=Slider(2, range=0..10), Values=neg, Constraints=[True, True, True])
conlecnt = ConstructLeControl(SolutionType=Slider(0, range=0..1), BoundaryConditions=flatten([conbc, conbc_2]), Step=constep, Solver=conss)
panel = Panel(conlecnt)
panel_2 = Panel(lefi.LeMesh)
conleasm = LeAssembleModel(LeMesh=lefi.LeMesh, LeGrp=flatten([congrpsurf.Group, grpentire, congrpsurf_2.Group]), LeMat=conlemat, LeControl=conlecnt)
path = FilePath("C:\Users\hiroa\Desktop\lemur_test\")
panel_3 = Panel(conleasm)
leexe = LeExecute(LeAssemble=conleasm, Thread="-1", Process="1", Dir=path, Run=Toggle(True))  # -> LeMesh, Dir
panel_4 = Panel(leexe.LeMesh)
number_slider_3 = Slider(1, range=0..10)

getnodalresult = NodalResult(LeMesh=leexe.LeMesh, TargetResultName="DISPLACEMENT", Step=number_slider_3, NodeIDs=congrpsurf_2.NodeIds)
num2pt = NumbersToPoints(Numbers=getnodalresult, Mask=4)
vlen = VectorLength(Vector=num2pt)  # -> flatten(Length)
sort = SortList(Keys=vlen)  # -> Keys, ValuesA
lastdex = LastIndex(List=sort.Keys)
item_3 = ListItem(List=sort.Keys, Index=lastdex, Wrap=True)
panel_5 = Panel(item_3)

getnodalresult_2 = NodalResult(LeMesh=leexe.LeMesh, TargetResultName="REACTION_FORCE", Step=number_slider_3, NodeIDs=congrpsurf.NodeIds)
num2pt_2 = NumbersToPoints(Numbers=getnodalresult_2, Mask=4)
ma = MassAddition(Input=flatten(num2pt_2))  # -> Result, PartialResults
panel_6 = Panel(ma.Result)

number_slider_4 = Slider(10, range=0..10)
lecontour = ShowResultContour(
    LeMesh=leexe.LeMesh,
    Step=number_slider_3,
    ResultName="DISPLACEMENT",
    ContourSet=Slider(2, range=0..10),
    DispScale=Slider(286, range=0..1000))  # -> Mesh, Color, Text
legend = Legend(Colour=lecontour.Color, Tags=lecontour.Text, LegendType=1)
