# Grasshopper definition lattice.gh (Grasshopper 1.0.8)
# Copyright: hrntsm
# plug-ins: Pufferfish, Lemur Info, IguanaMesh

number_slider = Slider(0.4, range=0..1)
ilineartetraprism = ILinearTetraPrism(
    MinimumSize=number_slider,
    MaximunSize=number_slider,
    CurvatureAdapt=False,
    MinimumElements=6,
    Optimization=0,
    QualityType=2,
    QualityThreshold=0.3,
    Massive_Refinement=False)
brep = Brep(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)
ifillbrep = IFillBrep(Brep=brep, ISettings=ilineartetraprism)  # -> IMesh, Entities, Info
debrep = DeconstructBrep(Brep=brep)  # -> Faces, Edges, Vertices
lefi = LeMeshFromIMesh(Header="lattice", IMesh=ifillbrep.IMesh)  # -> LeMesh, Mesh
Z = UnitZ(Factor=Slider(1, range=0..1))
item = ListItem(List=debrep.Faces, Index=Slider(99, range=0..100), Wrap=True)
item_2 = ListItem(List=debrep.Faces, Index=Slider(10, range=0..100), Wrap=True)
vec = VectorXYZ(XComponent=0, YComponent=0, ZComponent=0)  # -> Vector, Length
neg = Negative(Value=Z)
conss = ConstructSolverSettings(Method=Slider(0, range=0..12), Precondition=Slider(5, range=0..12), MaxIter=100, Residual=1e-08)
constep = ConstructStep(SubSteps=Slider(10, range=0..10), Convergence=1e-06, MaxIterations=100)
conlemat = ConstructLeMaterial(Name="steel", Density="1", YoungsModulus="205000", PoissonRatio="0.3", TargetEGroup="EGRP1")
grpentire = GroupEntireLeMesh(Name="EGRP1", LeMesh=lefi.LeMesh)
conbc = ConstructBoundaryCondition(TargetGroupName="Fix", Type=0, Values=vec.Vector, Constraints=[True, True, True])
conbc_2 = ConstructBoundaryCondition(TargetGroupName="Load", Type=Slider(0, range=0..10), Values=neg, Constraints=[False, False, True])
congrpsurf = GroupFromSurface(Name="Fix", LeMesh=lefi.LeMesh, Surface=item_2, GroupType=Slider(0, range=0..2), Tolerance=1e-06)  # -> Group, Geometry, NodeIds
congrpsurf_2 = GroupFromSurface(Name="Load", LeMesh=lefi.LeMesh, Surface=item, GroupType=Slider(0, range=0..2), Tolerance=1e-06)  # -> Group, Geometry, NodeIds
conlecnt = ConstructLeControl(SolutionType=Slider(1, range=0..1), BoundaryConditions=flatten([conbc, conbc_2]), Step=constep, Solver=conss)
panel = Panel(conlecnt)
conleasm = LeAssembleModel(LeMesh=lefi.LeMesh, LeGrp=flatten([congrpsurf.Group, grpentire, congrpsurf_2.Group]), LeMat=conlemat, LeControl=conlecnt)
path = FilePath("C:\Users\hiroa\Desktop\lemur_test\")
panel_2 = Panel(conleasm)
leexe = LeExecute(LeAssemble=conleasm, Thread="-1", Process="1", Dir=path, Run=Toggle(True))  # -> LeMesh, Dir
panel_3 = Panel(leexe.LeMesh)
number_slider_2 = Slider(10, range=0..10)

getnodalresult = NodalResult(LeMesh=leexe.LeMesh, TargetResultName="DISPLACEMENT", Step=number_slider_2, NodeIDs=congrpsurf_2.NodeIds)
num2pt = NumbersToPoints(Numbers=getnodalresult, Mask=4)
vlen = VectorLength(Vector=num2pt)  # -> flatten(Length)
sort = SortList(Keys=vlen)  # -> Keys, ValuesA
lastdex = LastIndex(List=sort.Keys)
item_3 = ListItem(List=sort.Keys, Index=lastdex, Wrap=True)
panel_4 = Panel(item_3)

getnodalresult_2 = NodalResult(LeMesh=leexe.LeMesh, TargetResultName="REACTION_FORCE", Step=number_slider_2, NodeIDs=congrpsurf.NodeIds)
num2pt_2 = NumbersToPoints(Numbers=getnodalresult_2, Mask=4)
ma = MassAddition(Input=flatten(num2pt_2))  # -> Result, PartialResults
panel_5 = Panel(ma.Result)

number_slider_3 = Slider(10, range=0..10)
lecontour = ShowResultContour(
    LeMesh=leexe.LeMesh,
    Step=number_slider_2,
    ResultName="NodalMISES",
    ContourSet=Slider(2, range=0..10),
    DispScale=Slider(2, range=0..10))  # -> Mesh, Color, Text
legend = Legend(Colour=lecontour.Color, Tags=lecontour.Text, LegendType=1)
